# Grasshopper definition 190429 Machina Bridge.gh (Grasshopper 1.0.7)
# plug-ins: Machina

toolpath = Curve(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)  # disabled

# ---- group: 6-Axis Motion (USE CAUTION)
# Exercise extreme caution when programming joint movements/6-axis
# movement. The robot may move unpredictably. The "TransformTo"
# component is your best bet for complex programs and provides the
# most control over the robot's TCP orientation.
# 
# Always test your program at extremely low speeds (<20mm/s) before
# executing faster.
perp_frames = PerpFrames(Curve=toolpath, Count=30, Align=True)  # -> simplify(graft(Frames)), Parameters; disabled
deconstruct_plane = DeconstructPlane(Plane=perp_frames.Frames)  # -> Origin, XAxis, YAxis, ZAxis; disabled
rotate_direction = RotateDirection(Geometry=perp_frames.Frames, Center=deconstruct_plane.Origin, From=deconstruct_plane.ZAxis, To=deconstruct_plane.XAxis)  # -> Geometry, Transform; disabled
flatten_tree = FlattenTree(Tree=rotate_direction.Geometry, Path="{0}")  # disabled
transformto = TransformTo(Plane=flatten_tree, Relative=False)  # disabled

# ----
customcode = CustomCode(IsDeclaration=False)  # disabled
writeanalog = WriteAnalog(AnalogPin="1", Value=0, ToolPin=False)  # disabled
toolpath_2 = Curve(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)  # disabled

# ---- group: Standard 3 Axis Motion Using Robot Arm (No rotation of TCP in 3d space)
number_slider = Slider(26, range=0..50)  # disabled
divide_curve = DivideCurve(Curve=toolpath_2, Count=number_slider, Kinks=False)  # -> flatten(Points), Tangents, Parameters; disabled
panel = Panel("20")  # disabled
moveto = MoveTo(Point=divide_curve.Points, Relative=False)  # -> simplify(flatten(Action)); disabled
speedto = SpeedTo(Speed=panel, Relative=False)  # disabled

# ---- group: Set Joint and Rotation Speeds
default_speed = Slider(0, range=0..100)  # disabled
number_slider_2 = Slider(5, range=1..30)  # disabled
number_slider_3 = Slider(3, range=1..30)  # disabled
number_slider_4 = Slider(5, range=1..30)  # disabled
jointaccelerationto = JointAccelerationTo(JointAccelerationInc=default_speed, Relative=False)  # disabled
rotationspeedto = RotationSpeedTo(RotationSpeedInc=default_speed, Relative=False)  # disabled
jointspeedto = JointSpeedTo(JointSpeed=default_speed, Relative=False)  # disabled

# ---- group: Relative Move
number_slider_5 = Slider(0, range=0..100)  # disabled
number_slider_6 = Slider(40, range=0..100)  # disabled
number_slider_7 = Slider(0, range=0..100)  # disabled
vector_xyz = VectorXYZ(XComponent=number_slider_7, YComponent=number_slider_5, ZComponent=number_slider_6)  # -> Vector, Length; disabled
move = Move(Vector=vector_xyz.Vector, Relative=True)  # -> simplify(flatten(Action)); disabled
negative = Negative(Value=vector_xyz.Vector)  # disabled

# ----
wait = Wait(Time="40000")

speedto_2 = SpeedTo(Speed="10", Relative=False)

# ---- group: Direction. TRUE = forward, FALSE = backward
writedigital = WriteDigital(DigitalPin="DO10_2", On=Toggle(False), ToolPin=False)

# ---- group: Turn motor on
writedigital_2 = WriteDigital(DigitalPin="DO10_1", On=Toggle(True), ToolPin=False)

# ----
number = Number("0")
number_2 = Number("0")
number_3 = Number("-100")
vector_xyz_2 = VectorXYZ(XComponent=number, YComponent=number_2, ZComponent=number_3)  # -> Vector, Length

number_4 = Number("100")
number_5 = Number("900")
number_6 = Number("100")
vector_xyz_3 = VectorXYZ(XComponent=number_4, YComponent=number_5, ZComponent=number_6)  # -> Vector, Length

panel_2 = Panel(speedto_2)

# ---- group: Turn motor off
writedigital_3 = WriteDigital(DigitalPin="DO10_1", On=Toggle(False), ToolPin=False)

# ---- group: VECTOR MOVEMENT
number_7 = Number("0")
number_8 = Number("-200")
number_9 = Number("0")
vector_xyz_4 = VectorXYZ(XComponent=number_7, YComponent=number_8, ZComponent=number_9)  # -> Vector, Length

# ---- group: MOVE TO POINT
construct_point = ConstructPoint(XCoordinate=0, YCoordinate=0, ZCoordinate=0)
point = Point(<point referenced from the Rhino model>)
vector_2pt = Vector2Pt(PointA=construct_point, PointB=point, Unitize=False)  # -> Vector, Length

# ----
point_2 = Point(vector_xyz_4.Vector)
point_3 = Point(vector_xyz_2.Vector)
point_4 = Point(vector_xyz_3.Vector)
move_2 = Move(Vector=vector_xyz_4.Vector, Relative=True)
move_3 = Move(Vector=vector_xyz_2.Vector, Relative=True)
move_4 = Move(Vector=vector_xyz_3.Vector, Relative=True)

# ---- group: Merge all of your actions here, in chronological order
merge = Merge(Data1=speedto_2, Data2=writedigital_2, Data3=writedigital, Data4=wait, Data6=writedigital_3)

# ----
panel_3 = Panel(move_2)
panel_4 = Panel(merge)

construct_point_2 = ConstructPoint(XCoordinate="1000", YCoordinate="450", ZCoordinate="459")

moveto_2 = MoveTo(Point=construct_point_2, Relative=False)

# ---- group: Machina Bridge
reset = Button()
gate_not = GateNot(A=reset)
connect = Connect(URL="ws://127.0.0.1:6999/Bridge", Name="Grasshopper", Connect=gate_not)  # -> Messages, Bridge
panel_5 = Panel(connect.Messages)
panel_6 = Panel(connect.Bridge)

# ---- group: Live update
# NOTE: TIMING
# 
# robot has to complete its moveto task before it starts the next moveto. can't seamlessly follow - it's plotting points.
# 
# have to move it in increments rather than tooltip seamlessly following point
timer = Timer(TimerInterval=500, Target=c_script)  # disabled
c_script = CSharpScript()  # -> out, A
# ---------- c_script: C# ----------
    if(toggle==false)
      toggle = true;
    else
      toggle = false;
    A = toggle;
# ---------- c_script: C# additional code ----------
  bool toggle = false;
# ---------- end c_script ----------
boolean = Boolean(c_script.A)
# material tests - speed might not be an issue?
panel_7 = Panel(boolean)

# ----
send = Button()
send_2 = Send(Bridge=connect.Bridge, Actions=merge, Send=send)  # -> Sent, Instructions
panel_8 = Panel(send_2.Sent)
panel_9 = Panel(send_2.Instructions)

# ----
# Control extruder, link extruder to robot action
panel_10 = Panel("20")
num_inputs = Slider(16, range=0..16)
wait_2 = Wait(Time="800")

# ---- group: Binary Conversion Function
ghpython_script = GhPythonScript(steps="-32000", pulse_width=panel_10)  # -> bool_list, num_chunks
# ---------- ghpython_script: Python ----------
"""Provides a scripting component.
    Inputs:
        steps: Steps motor will take
        pulse_width: Pulse width of each step (in microseconds)
    Output:
        bool_list: List of on/off commands for the 16 pins
        num_chunks: Number of times a command is sent out to the 16 pins"""

__author__ = "Kevin Guo"
__version__ = "2019.07.26"

BITS = 16
OFF = 0
DELIMITER = -1

#assumes pulse width will never overflow

def createCommands(stps,pulse):
    chunk_number = 0
    final_outputs = []
    cmd_list_steps,num_chunks_steps = interpretChunks(stps)
    cmd_list_delimeter = interpret(DELIMITER)
    cmd_list_pulse = interpret(pulse)
    cmd_list_off = interpret(OFF)

    for i in range(num_chunks_steps):
        # adds step commands to outputs
        final_outputs.extend(cmd_list_steps[16*i:16*(i+1)])
        # adds delimeter commands to outputs
        final_outputs.extend(cmd_list_delimeter)
        # adds pulse width commands to outputs
        final_outputs.extend(cmd_list_pulse)
        final_outputs.extend(cmd_list_off)
        chunk_number += 4

    return final_outputs,chunk_number

def interpretChunks(number):
    # sets up default values of variables
    chunk_amount = 1
    chunks = []

    # splits the number into chunks
    if number > 32767:
        chunk_amount = int(number / 32767)
        for i in range(chunk_amount):
            chunks.append(32767)
        if number % 32767 > 0:
            chunks.append(number % 32767)
            chunk_amount += 1
    elif number < -32768:
        chunk_amount = int(number / -32768)
        for i in range(chunk_amount):
            chunks.append(-32768)
        if number % -32768 < 0:
            chunks.append(number % -32768)
            chunk_amount += 1
    else:
        chunks.append(number)

    output = []

    for i in range(chunk_amount):
        output.extend(interpret(chunks[i]))

    return output,chunk_amount

def interpret(num):
    out = [None] * BITS
    is_negative = False

    if num < 0:
        is_negative = True
        num = abs(num)

    binary = bin(num)[2:].zfill(BITS-1)

    for i in range(BITS-2,-1,-1):
        if int(binary[i]) == 1:
            out[BITS-2-i] = True
        else:
            out[BITS-2-i] = False
    if is_negative:
        out[BITS-1] = False
    else:
        out[BITS-1] = True
    return out

bool_list,num_chunks = createCommands(int(steps),int(pulse_width))
# ---------- end ghpython_script ----------
panel_11 = Panel(ghpython_script.bool_list)

# ----
panel_12 = Panel(ghpython_script.num_chunks)
series = Series(Start=16, Step=16, Count=ghpython_script.num_chunks)

# ---- group: Sequence Generator
series_2 = Series(Start=1, Step=1, Count=num_inputs)
duplicate_data = DuplicateData(Data=series_2, Number=ghpython_script.num_chunks, Order=True)

# ----
integer = Integer(duplicate_data)
concatenate = Concatenate(FragmentA="DO10_", FragmentB=integer)
panel_13 = Panel(concatenate)

# ---- group: Sequence Generator (continued)
writedigital_4 = WriteDigital(DigitalPin=concatenate, On=ghpython_script.bool_list, ToolPin=False)

# ----
insert_items = InsertItems(List=writedigital_4, Item=wait_2, Indices=series, Wrap=True)  # -> flatten(List)
panel_14 = Panel(insert_items)

priming_distance_mm = Panel("75")

# ---- group: delay for priming (ms)
delay_for_priming_ms = DelayForPrimingMs(A=priming_distance_mm, B="10")

# ----
wait_3 = Wait(Time=delay_for_priming_ms)

# ==== cluster DelayForPrimingMs
A = ClusterInput()
B = ClusterInput()
integer_division = IntegerDivision(A=A, B=B)
multiplication = Multiplication(A=integer_division, B=" 1000")
result = ClusterOutput(multiplication)
