# Grasshopper definition 190501 Arduino Test (Serial).gh (Grasshopper 1.0.7)
# plug-ins: Firefly.X, Machina, Firefly.Core

of_motor_rotations = Slider(500, range=0.001..500)
toolpath = Curve(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)
panel = Panel("-800")
multiplication = Multiplication(A=of_motor_rotations, B="800")
round = Round(Number=multiplication)  # -> Nearest, Floor, Ceiling
round_2 = Round(Number=Slider(5, range=5..10000))  # -> Nearest, Floor, Ceiling

pulse_width = Panel(round_2.Nearest)
panel_2 = Panel(round.Nearest)
concat = Concatenate(FragmentA=panel_2, FragmentB="/", FragmentC=pulse_width)
txt = Text(concat)
panel_3 = Panel(txt)

multiplication_2 = Multiplication(A="-1", B=round.Nearest)
panel_4 = Panel(multiplication_2)

pframes = PerpFrames(Curve=toolpath, Count=30, Align=True)  # -> simplify(graft(Frames)), Parameters
deplane = DeconstructPlane(Plane=pframes.Frames)  # -> Origin, XAxis, YAxis, ZAxis
rotate = RotateDirection(Geometry=pframes.Frames, Center=deplane.Origin, From=deplane.ZAxis, To=deplane.XAxis)  # -> Geometry, Transform
flatten = FlattenTree(Tree=rotate.Geometry, Path="{0}")
transformto = TransformTo(Plane=flatten, Relative=False)

toolpath_2 = Curve(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)

# ---- group: Actions
divide = DivideCurve(Curve=toolpath, Count=Slider(24, range=0..50), Kinks=False)  # -> flatten(Points), Tangents, Parameters
moveto = MoveTo(Point=divide.Points, Relative=False)  # -> simplify(flatten(Action))
speedto = SpeedTo(Speed="30", Relative=False)

# ---- group: Set Joint and Rotation Speeds
default_speed = Slider(0, range=0..100)
number_slider = Slider(5, range=1..30)
number_slider_2 = Slider(3, range=1..30)
number_slider_3 = Slider(5, range=1..30)
rotationspeedto = RotationSpeedTo(RotationSpeedInc=default_speed, Relative=False)
jointaccelerationto = JointAccelerationTo(JointAccelerationInc=default_speed, Relative=False)
jointspeedto = JointSpeedTo(JointSpeed=default_speed, Relative=False)

# ---- group: Relative Move
vec = VectorXYZ(XComponent=Slider(0, range=0..100), YComponent=Slider(0, range=0..100), ZComponent=Slider(40, range=0..100))  # -> Vector, Length
move = Move(Vector=vec.Vector, Relative=True)  # -> simplify(flatten(Action))
neg = Negative(Value=vec.Vector)

# ---- group: Standard 3 Axis Motion Using Robot Arm (No rotation of TCP in 3d space)
divide_2 = DivideCurve(Curve=toolpath_2, Count=Slider(26, range=0..50), Kinks=False)  # -> flatten(Points), Tangents, Parameters
moveto_2 = MoveTo(Point=divide_2.Points, Relative=False)  # -> simplify(flatten(Action))
speedto_2 = SpeedTo(Speed="20", Relative=False)

# ----
toggle = BooleanToggle(True)
filter = StreamFilter(Gate=Button(), Stream1=txt)
panel_5 = Panel(filter)

toggle_2 = BooleanToggle(True)
timer = Timer(TimerInterval=10, Target=read)
merge = Merge(Data1=speedto, Data2=jointspeedto, Data3=jointaccelerationto, Data4=rotationspeedto, Data5=transformto)

# ---- group: Merge all of your actions here, in chronological order
merge_2 = Merge(Data1=speedto_2, Data2=moveto_2)

# ---- group: Machina Bridge
reset = Button()
not = GateNot(A=reset)
connect = Connect(URL="ws://127.0.0.1:6999/Bridge", Name="Grasshopper", Connect=not)  # -> Messages, Bridge
panel_6 = Panel(connect.Messages)
panel_7 = Panel(connect.Bridge)

# ---- group: Open Port
ports_available = COMPortsAvailable()
number_slider_4 = Slider(7, range=0..10)
panel_8 = Panel(ports_available)
item = ListItem(List=panel_8, Index=0, Wrap=True)  # -> Item, Item1
panel_9 = Panel(item.Item1)
open_port = OpenClosePort(OpenClosePort=Toggle(True), PortNumber=number_slider_4, BaudRate="115200")
panel_10 = Panel(open_port)

# ----
write = SerialWriteGeneric(StartWritingValues=toggle_2, WriteData=filter, PortNumber=number_slider_4)  # -> ArduinoOutput, StatusMessage
read = SerialReadGeneric(StartReadingValues=toggle_2, PortNumber=number_slider_4)  # -> SerialOutput, StatusMessage
panel_11 = Panel(write.ArduinoOutput)
panel_12 = Panel(write.StatusMessage)
panel_13 = Panel(read.SerialOutput)
panel_14 = Panel(read.StatusMessage)
crv = Curve(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)
number_slider_5 = Slider(200, range=0..200)
number_slider_6 = Slider(0, range=0..200)
number_slider_7 = Slider(0, range=0..200)
simplify = SimplifyCurve(Curve=crv)  # -> Curve, Simplified
explode = Explode(Curve=simplify.Curve, Recursive=True)  # -> Segments, Vertices
toggle_3 = BooleanToggle(True)
len = Length(Curve=explode.Segments)
vec_2 = VectorXYZ(XComponent=number_slider_5, YComponent=number_slider_6, ZComponent=number_slider_7)  # -> Vector, Length
division = Division(A=len, B="50")
moveto_3 = MoveTo(Point=explode.Vertices, Relative=False)  # -> simplify(flatten(Action))
travel_time = Panel(division)
move_2 = Move(Vector=vec_2.Vector, Relative=True)

send = Button()
send_2 = Send(Bridge=connect.Bridge, Actions=move_2, Send=send)  # -> Sent, Instructions
panel_15 = Panel(send_2.Sent)
panel_16 = Panel(send_2.Instructions)

speedto_3 = SpeedTo(Speed="50", Relative=False)
pt = ConstructPoint(XCoordinate=number_slider_5, YCoordinate=number_slider_6, ZCoordinate=number_slider_7)
moveto_4 = MoveTo(Point=pt, Relative=False)
merge_3 = Merge(Data1=speedto_3, Data2=moveto_3)

# ---- group: Machina Bridge
reset_2 = Button()
not_2 = GateNot(A=reset_2)
connect_2 = Connect(URL="ws://127.0.0.1:6999/Bridge", Name="Grasshopper", Connect=not_2)  # -> Messages, Bridge
panel_17 = Panel(connect_2.Messages)
panel_18 = Panel(connect_2.Bridge)

# ----
send_3 = Button()
send_4 = Send(Bridge=connect_2.Bridge, Actions=merge_3, Send=send_3)  # -> Sent, Instructions
panel_19 = Panel(send_4.Sent)
panel_20 = Panel(send_4.Instructions)

number_slider_8 = Slider(0.868, range=0..1)  # disabled
panel_21 = Panel("840")  # disabled
multiplication_3 = Multiplication(A=panel_21, B=number_slider_8)  # disabled
int = Integer(multiplication_3)  # disabled

number_slider_9 = Slider(7, range=0..10)  # disabled
timer_2 = Timer(TimerInterval=1000)  # disabled
toggle_4 = BooleanToggle(True)  # disabled
toggle_5 = BooleanToggle(True)  # disabled
timer_3 = Timer(TimerInterval=20, Target=uno_write)  # disabled
uno_write = UnoWrite(
    StartWritingValues=toggle_4,
    DigitalPin13=0,
    DigitalPin12=0,
    DigitalPin11=0,
    DigitalPin10=0,
    DigitalPin9=0,
    DigitalPin8=0,
    DigitalPin6=0,
    DigitalPin5=0,
    DigitalPin3=0,
    PortNumber=number_slider_9)  # -> ArduinoOutput, StatusMessage; disabled
open_port_2 = OpenClosePort(OpenClosePort=toggle_5, PortNumber=number_slider_9, BaudRate=115200)  # disabled
number_slider_10 = Slider(1, range=1..20000)  # disabled
panel_22 = Panel(open_port_2)  # disabled
codegen = CodeGenerator(Input=uno_write.ArduinoOutput)  # disabled
panel_23 = Panel(codegen)  # disabled

number_slider_11 = Slider(355, range=0..840)  # disabled
panel_24 = Panel("2500")  # disabled
series = Series(Start=panel_24, Step=0, Count=number_slider_11)  # -> flatten(Series); disabled
lng = ListLength(List=series)  # disabled
panel_25 = Panel(series)  # disabled
panel_26 = Panel(lng)  # disabled

toggle_6 = BooleanToggle(False)  # disabled
blink = BinaryBlink(BlinkPattern=series, Start=toggle_6, Repeat=invert(True))  # disabled
max = Maximum(A=blink, B=1)  # disabled

ports_available_2 = COMPortsAvailable()  # disabled
panel_27 = Panel(ports_available_2)  # disabled
toggle_7 = BooleanToggle(False)  # disabled
item_2 = ListItem(List=panel_27, Index=0, Wrap=True)  # -> Item, Item1; disabled
toggle_8 = BooleanToggle(False)  # disabled
open_port_3 = OpenClosePort(OpenClosePort=toggle_7, PortNumber=item_2.Item, BaudRate=9600)  # disabled
panel_28 = Panel(open_port_3)  # disabled
uno_write_2 = UnoWrite(
    StartWritingValues=toggle_8,
    DigitalPin13=0,
    DigitalPin12=0,
    DigitalPin11=0,
    DigitalPin10=max,
    DigitalPin9=blink,
    DigitalPin8=0,
    DigitalPin6=max,
    DigitalPin5=blink,
    DigitalPin3=0,
    PortNumber=item_2.Item)  # -> ArduinoOutput, StatusMessage; disabled
panel_29 = Panel(max)  # disabled
panel_30 = Panel(blink)  # disabled
panel_31 = Panel(uno_write_2.ArduinoOutput)  # disabled
panel_32 = Panel(uno_write_2.StatusMessage)  # disabled

pulse_delay = Panel("100")
addition = Addition(A=pulse_width, B=pulse_delay)
total_cycle_length_microseconds = Panel(addition)
multiplication_4 = Multiplication(A=panel_2, B=total_cycle_length_microseconds)
panel_33 = Panel(multiplication_4)

# ---- group: microsec to sec
division_2 = Division(A=multiplication_4, B=1000000)

# ----
total_cycle_length_seconds = Panel(division_2)
